# Grasshopper definition udpOsc01.gh (Grasshopper 1.0.7)

panel = Panel("Working")
timer = Timer(TimerInterval=100, Target=c_script_2)  # disabled
timer_2 = Timer(TimerInterval=20, Target=c_script)  # disabled
c_script = CSharpScript(Run=Button(), Close=Button(), Reference="D:\Dropbox\Mirror\C1909_CorpoReality\Workshop\SharpOSC.dll")  # -> out, A; inputs Run: Boolean, Close: Boolean
# ---------- c_script: C# usings ----------
using SharpOSC;
# ---------- c_script: C# ----------
    if(Run) {
      if( listener != null) {
        listener.Close();
      }

      listener = new UDPListener(8888);
      messageReceived = null;

    }

    if(Close) {
      listener.Close();
    }

    if(listener != null) {
      messageReceived = (OscMessage) listener.Receive();
    }

    if(messageReceived != null) {
      A = messageReceived;
    }
# ---------- c_script: C# additional code ----------
  UDPListener listener;
  OscMessage messageReceived;
# ---------- end c_script ----------
c_script_2 = CSharpScript(Run=Button(), Reference="D:\Dropbox\Mirror\C1909_CorpoReality\Workshop\SharpOSC.dll")  # -> out, A; inputs Run: Boolean
# ---------- c_script_2: C# ----------
    if(Run) {
      message = new SharpOSC.OscMessage("/test/1", 23, 42.01f, "hello world");
      if(sender == null) {
        sender = new SharpOSC.UDPSender("127.0.0.1", 55555);
      }
      if(sender != null) {
        sender.Send(message);
      }
    }
# ---------- c_script_2: C# additional code ----------
  UDPSender sender;
  OscMessage message;
# ---------- end c_script_2 ----------
rec = DataRecorder(c_script.A, DataLimit=-10, RecordData=True)
panel_2 = Panel(c_script.out)
panel_3 = Panel(rec)
